# Grasshopper definition Handwriting 001.gh (Grasshopper 1.0.7)
# plug-ins: InteracTool, MetaHopper

# ----
# Legend:
# Control
# List Management
# Geometry operations
# Canvas organisation
# Output Geometry
# All Components Used: DATE- 2019.04.20 TIME- 09:54h
# Last saved by - Robin
# Total Components - 133
# MetaHopper:
# ...Attributes:
# ......Set Sketch - 1
# ...Object Retrieval:
# ......Get Objects in Group - 1
# ......Get Groups - 1
# Params:
# ...Geometry:
# ......Curve - 4
# ......Point - 13
# ...Util:
# ......Sketch - 2
# ......Relay - 2
# ......Data Recorder - 2
# ......Scribble - 23
# ......Jump - 8
# ...Primitive:
# ......Integer - 8
# ......Boolean - 2
# ...Input:
# ......Boolean Toggle - 1
# ......Number Slider - 2
# ......Panel - 24
# ......Button - 2
# Display:
# ...Interact:
# ......Mouse Event - 1
# Curve:
# ...Util:
# ......Reduce - 1
# ...Spline:
# ......Interpolate - 2
# ......PolyLine - 1
# ...Analysis:
# ......Control Points - 1
# Maths:
# ...Operators:
# ......Equality - 2
# ......Subtraction - 4
# ......Addition - 1
# ...Script:
# ......C# Script - 1
# ...Domain:
# ......Consecutive Domains - 1
# ......Deconstruct Domain - 1
# OTools:
# ...3 | Debugging:
# ......OTools_GetComponents2 - 1
# Sets:
# ...Sequence:
# ......Series - 3
# ......Cull Pattern - 3
# ...List:
# ......Shift List - 1
# ......List Length - 5
# ......Dispatch - 1
# ......List Item - 1
# ......Partition List - 1
# ...Tree:
# ......Merge - 1
# ......Clean Tree - 1
# ......Tree Branch - 2
# ...Sets:
# ......Member Index - 1
update_component_list = Button()
plugins_used = Panel("""InteracTool 
MetaHopper 1.2.0""")
o_getcomps2 = OTools_GetComponents2(x=update_component_list)  # inputs x: Boolean; plug-in component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

# ---- group: Controls
# Handwriting v_1.0
# Created by Robin Godwyll
# BURG Halle University of Art and Design Germany
# Robot Lab Residency Spring 2019
# Start / Stop
enable = BooleanToggle(True)

# Reset
reset = Button()

# ---- group: Get Mouse position on the canvas
# Sketch Preview
# Comment: Creates a Sketch of the drawn curves on the grasshopper canvas
# 
# needs the plugin Metahopper
panel = Panel(enable)
mouse_event = MouseEvent(Start=panel)  # -> Line, Point, Button, Double, SPoint
boolean = Boolean(mouse_event.Button)
point = Panel(mouse_event.Point)
point_2 = Panel(mouse_event.SPoint)
mouse_pressed = Panel(boolean)

# Comment: Uses the plugin interactiontools to monitor:
# - position of the cursor in the viewport
# - mouse pressed state
integer = Integer(mouse_event.Button)
point_3 = Point(mouse_event.Point)

# ----
license = Panel("""                    GNU GENERAL PUBLIC LICENSE
                       Version 3, 29 June 2007

 Copyright (C) 2007 Free Software Foundation, Inc. <https://fsf.org/>
 Everyone is permitted to copy and distribute verbatim copies
 of this license document, but changing it is not allowed.

                            Preamble

  The GNU General Public License is a free, copyleft license for
software and other kinds of works.

  The licenses for most software and other practical works are designed
to take away your freedom to share and change the works.  By contrast,
the GNU General Public License is intended to guarantee your freedom to
share and change all versions of a program--to make sure it remains free
software for all its users.  We, the Free Software Foundation, use the
GNU General Public License for most of our software; it applies also to
any other work released this way by its authors.  You can apply it to
your programs, too.

  When we speak of free software, we are referring to freedom, not
price.  Our General Public Licenses are designed to make sure that you
have the freedom to distribute copies of free software (and charge for
them if you wish), that you receive source code or can get it if you
want it, that you can change the software or use pieces of it in new
free programs, and that you know you can do these things.

  To protect your rights, we need to prevent others from denying you
these rights or asking you to surrender the rights.  Therefore, you have
certain responsibilities if you distribute copies of the software, or if
you modify it: responsibilities to respect the freedom of others.

  For example, if you distribute copies of such a program, whether
gratis or for a fee, you must pass on to the recipients the same
freedoms that you received.  You must make sure that they, too, receive
or can get the source code.  And you must show them these terms so they
know their rights.

  Developers that use the GNU GPL protect your rights with two steps:
(1) assert copyright on the software, and (2) offer you this License
giving you legal permission to copy, distribute and/or modify it.

  For the developers' and authors' protection, the GPL clearly explains
that there is no warranty for this free software.  For both users' and
authors' sake, the GPL requires that modified versions be marked as
changed, so that their problems will not be attributed erroneously to
authors of previous versions.

  Some devices are designed to deny users access to install or run
modified versions of the software inside them, although the manufacturer
can do so.  This is fundamentally incompatible with the aim of
protecting users' freedom to change the software.  The systematic
pattern of such abuse occurs in the area of products for individuals to
use, which is precisely where it is most unacceptable.  Therefore, we
have designed this version of the GPL to prohibit the practice for those
products.  If such problems arise substantially in other domains, we
stand ready to extend this provision to those domains in future versions
of the GPL, as needed to protect the freedom of users.

  Finally, every program is threatened constantly by software patents.
States should not allow patents to restrict development and use of
software on general-purpose computers, but in those that do, we wish to
avoid the special danger that patents applied to a free program could
make it effectively proprietary.  To prevent this, the GPL assures that
patents cannot be used to render the program non-free.

  The precise terms and conditions for copying, distribution and
modification follow.

                       TERMS AND CONDITIONS

  0. Definitions.

  "This License" refers to version 3 of the GNU General Public License.

  "Copyright" also means copyright-like laws that apply to other kinds of
works, such as semiconductor masks.

  "The Program" refers to any copyrightable work licensed under this
License.  Each licensee is addressed as "you".  "Licensees" and
"recipients" may be individuals or organizations.

  To "modify" a work means to copy from or adapt all or part of the work
in a fashion requiring copyright permission, other than the making of an
exact copy.  The resulting work is called a "modified version" of the
earlier work or a work "based on" the earlier work.

  A "covered work" means either the unmodified Program or a work based
on the Program.

  To "propagate" a work means to do anything with it that, without
permission, would make you directly or secondarily liable for
infringement under applicable copyright law, except executing it on a
computer or modifying a private copy.  Propagation includes copying,
distribution (with or without modification), making available to the
public, and in some countries other activities as well.

  To "convey" a work means any kind of propagation that enables other
parties to make or receive copies.  Mere interaction with a user through
a computer network, with no transfer of a copy, is not conveying.

  An interactive user interface displays "Appropriate Legal Notices"
to the extent that it includes a convenient and prominently visible
feature that (1) displays an appropriate copyright notice, and (2)
tells the user that there is no warranty for the work (except to the
extent that warranties are provided), that licensees may convey the
work under this License, and how to view a copy of this License.  If
the interface presents a list of user commands or options, such as a
menu, a prominent item in the list meets this criterion.

  1. Source Code.

  The "source code" for a work means the preferred form of the work
for making modifications to it.  "Object code" means any non-source
form of a work.

  A "Standard Interface" means an interface that either is an official
standard defined by a recognized standards body, or, in the case of
interfaces specified for a particular programming language, one that
is widely used among developers working in that language.

  The "System Libraries" of an executable work include anything, other
than the work as a whole, that (a) is included in the normal form of
packaging a Major Component, but which is not part of that Major
Component, and (b) serves only to enable use of the work with that
Major Component, or to implement a Standard Interface for which an
implementation is available to the public in source code form.  A
"Major Component", in this context, means a major essential component
(kernel, window system, and so on) of the specific operating system
(if any) on which the executable work runs, or a compiler used to
produce the work, or an object code interpreter used to run it.

  The "Corresponding Source" for a work in object code form means all
the source code needed to generate, install, and (for an executable
work) run the object code and to modify the work, including scripts to
control those activities.  However, it does not include the work's
System Libraries, or general-purpose tools or generally available free
programs which are used unmodified in performing those activities but
which are not part of the work.  For example, Corresponding Source
includes interface definition files associated with source files for
the work, and the source code for shared libraries and dynamically
linked subprograms that the work is specifically designed to require,
such as by intimate data communication or control flow between those
subprograms and other parts of the work.

  The Corresponding Source need not include anything that users
can regenerate automatically from other parts of the Corresponding
Source.

  The Corresponding Source for a work in source code form is that
same work.

  2. Basic Permissions.

  All rights granted under this License are granted for the term of
copyright on the Program, and are irrevocable provided the stated
conditions are met.  This License explicitly affirms your unlimited
permission to run the unmodified Program.  The output from running a
covered work is covered by this License only if the output, given its
content, constitutes a covered work.  This License acknowledges your
rights of fair use or other equivalent, as provided by copyright law.

  You may make, run and propagate covered works that you do not
convey, without conditions so long as your license otherwise remains
in force.  You may convey covered works to others for the sole purpose
of having them make modifications exclusively for you, or provide you
with facilities for running those works, provided that you comply with
the terms of this License in conveying all material for which you do
not control copyright.  Those thus making or running the covered works
for you must do so exclusively on your behalf, under your direction
and control, on terms that prohibit them from making any copies of
your copyrighted material outside their relationship with you.

  Conveying under any other circumstances is permitted solely under
the conditions stated below.  Sublicensing is not allowed; section 10
makes it unnecessary.

  3. Protecting Users' Legal Rights From Anti-Circumvention Law.

  No covered work shall be deemed part of an effective technological
measure under any applicable law fulfilling obligations under article
11 of the WIPO copyright treaty adopted on 20 December 1996, or
similar laws prohibiting or restricting circumvention of such
measures.

  When you convey a covered work, you waive any legal power to forbid
circumvention of technological measures to the extent such circumvention
is effected by exercising rights under this License with respect to
the covered work, and you disclaim any intention to limit operation or
modification of the work as a means of enforcing, against the work's
users, your or third parties' legal rights to forbid circumvention of
technological measures.

  4. Conveying Verbatim Copies.

  You may convey verbatim copies of the Program's source code as you
receive it, in any medium, provided that you conspicuously and
appropriately publish on each copy an appropriate copyright notice;
keep intact all notices stating that this License and any
non-permissive terms added in accord with section 7 apply to the code;
keep intact all notices of the absence of any warranty; and give all
recipients a copy of this License along with the Program.

  You may charge any price or no price for each copy that you convey,
and you may offer support or warranty protection for a fee.

  5. Conveying Modified Source Versions.

  You may convey a work based on the Program, or the modifications to
produce it from the Program, in the form of source code under the
terms of section 4, provided that you also meet all of these conditions:

    a) The work must carry prominent notices stating that you modified
    it, and giving a relevant date.

    b) The work must carry prominent notices stating that it is
    released under this License and any conditions added under section
    7.  This requirement modifies the requirement in section 4 to
    "keep intact all notices".

    c) You must license the entire work, as a whole, under this
    License to anyone who comes into possession of a copy.  This
    License will therefore apply, along with any applicable section 7
    additional terms, to the whole of the work, and all its parts,
    regardless of how they are packaged.  This License gives no
    permission to license the work in any other way, but it does not
    invalidate such permission if you have separately received it.

    d) If the work has interactive user interfaces, each must display
    Appropriate Legal Notices; however, if the Program has interactive
    interfaces that do not display Appropriate Legal Notices, your
    work need not make them do so.

  A compilation of a covered work with other separate and independent
works, which are not by their nature extensions of the covered work,
and which are not combined with it such as to form a larger program,
in or on a volume of a storage or distribution medium, is called an
"aggregate" if the compilation and its resulting copyright are not
used to limit the access or legal rights of the compilation's users
beyond what the individual works permit.  Inclusion of a covered work
in an aggregate does not cause this License to apply to the other
parts of the aggregate.

  6. Conveying Non-Source Forms.

  You may convey a covered work in object code form under the terms
of sections 4 and 5, provided that you also convey the
machine-readable Corresponding Source under the terms of this License,
in one of these ways:

    a) Convey the object code in, or embodied in, a physical product
    (including a physical distribution medium), accompanied by the
    Corresponding Source fixed on a durable physical medium
    customarily used for software interchange.

    b) Convey the object code in, or embodied in, a physical product
    (including a physical distribution medium), accompanied by a
    written offer, valid for at least three years and valid for as
    long as you offer spare parts or customer support for that product
    model, to give anyone who possesses the object code either (1) a
    copy of the Corresponding Source for all the software in the
    product that is covered by this License, on a durable physical
    medium customarily used for software interchange, for a price no
    more than your reasonable cost of physically performing this
    conveying of source, or (2) access to copy the
    Corresponding Source from a network server at no charge.

    c) Convey individual copies of the object code with a copy of the
    written offer to provide the Corresponding Source.  This
    alternative is allowed only occasionally and noncommercially, and
    only if you received the object code with such an offer, in accord
    with subsection 6b.

    d) Convey the object code by offering access from a designated
    place (gratis or for a charge), and offer equivalent access to the
    Corresponding Source in the same way through the same place at no
    further charge.  You need not require recipients to copy the
    Corresponding Source along with the object code.  If the place to
    copy the object code is a network server, the Corresponding Source
    may be on a different server (operated by you or a third party)
    that supports equivalent copying facilities, provided you maintain
    clear directions next to the object code saying where to find the
    Corresponding Source.  Regardless of what server hosts the
    Corresponding Source, you remain obligated to ensure that it is
    available for as long as needed to satisfy these requirements.

    e) Convey the object code using peer-to-peer transmission, provided
    you inform other peers where the object code and Corresponding
    Source of the work are being offered to the general public at no
    charge under subsection 6d.

  A separable portion of the object code, whose source code is excluded
from the Corresponding Source as a System Library, need not be
included in conveying the object code work.

  A "User Product" is either (1) a "consumer product", which means any
tangible personal property which is normally used for personal, family,
or household purposes, or (2) anything designed or sold for incorporation
into a dwelling.  In determining whether a product is a consumer product,
doubtful cases shall be resolved in favor of coverage.  For a particular
product received by a particular user, "normally used" refers to a
typical or common use of that class of product, regardless of the status
of the particular user or of the way in which the particular user
actually uses, or expects or is expected to use, the product.  A product
is a consumer product regardless of whether the product has substantial
commercial, industrial or non-consumer uses, unless such uses represent
the only significant mode of use of the product.

  "Installation Information" for a User Product means any methods,
procedures, authorization keys, or other information required to install
and execute modified versions of a covered work in that User Product from
a modified version of its Corresponding Source.  The information must
suffice to ensure that the continued functioning of the modified object
code is in no case prevented or interfered with solely because
modification has been made.

  If you convey an object code work under this section in, or with, or
specifically for use in, a User Product, and the conveying occurs as
part of a transaction in which the right of possession and use of the
User Product is transferred to the recipient in perpetuity or for a
fixed term (regardless of how the transaction is characterized), the
Corresponding Source conveyed under this section must be accompanied
by the Installation Information.  But this requirement does not apply
if neither you nor any third party retains the ability to install
modified object code on the User Product (for example, the work has
been installed in ROM).

  The requirement to provide Installation Information does not include a
requirement to continue to provide support service, warranty, or updates
for a work that has been modified or installed by the recipient, or for
the User Product in which it has been modified or installed.  Access to a
network may be denied when the modification itself materially and
adversely affects the operation of the network or violates the rules and
protocols for communication across the network.

  Corresponding Source conveyed, and Installation Information provided,
in accord with this section must be in a format that is publicly
documented (and with an implementation available to the public in
source code form), and must require no special password or key for
unpacking, reading or copying.

  7. Additional Terms.

  "Additional permissions" are terms that supplement the terms of this
License by making exceptions from one or more of its conditions.
Additional permissions that are applicable to the entire Program shall
be treated as though they were included in this License, to the extent
that they are valid under applicable law.  If additional permissions
apply only to part of the Program, that part may be used separately
under those permissions, but the entire Program remains governed by
this License without regard to the additional permissions.

  When you convey a copy of a covered work, you may at your option
remove any additional permissions from that copy, or from any part of
it.  (Additional permissions may be written to require their own
removal in certain cases when you modify the work.)  You may place
additional permissions on material, added by you to a covered work,
for which you have or can give appropriate copyright permission.

  Notwithstanding any other provision of this License, for material you
add to a covered work, you may (if authorized by the copyright holders of
that material) supplement the terms of this License with terms:

    a) Disclaiming warranty or limiting liability differently from the
    terms of sections 15 and 16 of this License; or

    b) Requiring preservation of specified reasonable legal notices or
    author attributions in that material or in the Appropriate Legal
    Notices displayed by works containing it; or

    c) Prohibiting misrepresentation of the origin of that material, or
    requiring that modified versions of such material be marked in
    reasonable ways as different from the original version; or

    d) Limiting the use for publicity purposes of names of licensors or
    authors of the material; or

    e) Declining to grant rights under trademark law for use of some
    trade names, trademarks, or service marks; or

    f) Requiring indemnification of licensors and authors of that
    material by anyone who conveys the material (or modified versions of
    it) with contractual assumptions of liability to the recipient, for
    any liability that these contractual assumptions directly impose on
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""")

# ---- group: Point recording
# Comment: Records the points of the mouse position as well as a boolean value (Integer 0 or 1) if the mouse is pressed. This boolean value is used to later group the points into curves that correspond with a mouseclick.
# 
# Also contains a script to reset the recorders. The script is by Marios Tsiliakos taken from:
# https://www.grasshopper3d.com/forum/topics/data-recorder-enable-record-boolean-input
point_4 = Point(point_3)
reset_2 = Boolean(reset)
integer_2 = Integer(integer)

cull_pattern = CullPattern(List=point_4, CullPattern=integer_2)
c_rec_reset = CSharpScript(clean=reset_2)  # inputs clean: Boolean, pause: Boolean
# ---------- c_rec_reset: C# usings ----------
using System.IO;
using System.Linq;
using System.Data;
using System.Drawing;
using System.Reflection;
using System.Windows.Forms;
using System.Xml;
using System.Xml.Linq;
using System.Runtime.InteropServices;

using Rhino.DocObjects;
using Rhino.Collections;
using GH_IO;
using GH_IO.Serialization;
# ---------- c_rec_reset: C# ----------
    //iterate through all the objects of the grashopper document;
    foreach (object obj in GrasshopperDocument.Objects)
    {
      //chek only for the GH_DataRecorder components
      if (obj is Grasshopper.Kernel.Special.GH_DataRecorder)
      {

        //cast the obj into GH_DataRecorder wrapper class to be able to access its methods
        Grasshopper.Kernel.Special.GH_DataRecorder dataDestroy = (Grasshopper.Kernel.Special.GH_DataRecorder) obj;
        //store the recording state of the component in a temp boolean
        bool recState = dataDestroy.RecordData;

        if(clean)
        {
          //clean the data and reset the recorder component
          dataDestroy.DestroyRecordedData();
          dataDestroy.ExpireSolution(true);
        }
        if(pause)
        {
          dataDestroy.RecordData = !recState;
          recState = dataDestroy.RecordData;
        }
      }
    }
# ---------- end c_rec_reset ----------
point_5 = Point(cull_pattern)
data_recorder = DataRecorder(point_5, DataLimit=-10, RecordData=True)
data_recorder_2 = DataRecorder(integer_2, DataLimit=-10, RecordData=True)

point_6 = Point(data_recorder)
integer_3 = Integer(data_recorder_2)

# ---- group: get indices for point grouping
# Comment: Turns the list of boolean values that determine weather the mouse is clicked into a list of indices.
integer_4 = Integer(integer_3)

list_length = ListLength(List=integer_4)
series = Series(Start=0, Step=1, Count=list_length)
cull_pattern_2 = CullPattern(List=series, CullPattern=integer_4)

integer_5 = Integer(cull_pattern_2)

# ---- group: Point list split indices
# Comment: Gets the indices at which to split the list of points to create individual curves instead of joining all points.
integer_6 = Integer(integer_5)

list_length_2 = ListLength(List=integer_6)
shift_list = ShiftList(List=integer_6, Shift=1, Wrap=True)
subtraction = Subtraction(A=shift_list, B=integer_6)
subtraction_2 = Subtraction(A=list_length_2, B="1")
equality = Equality(FirstNumber=subtraction, SecondNumber="1")  # -> Equality, Inequality
series_2 = Series(Start=0, Step=1, Count=subtraction_2)
cull_pattern_3 = CullPattern(List=series_2, CullPattern=equality.Inequality)

integer_7 = Integer(cull_pattern_3)

# ---- group: Split points into sublists
# Comment: Splits the list of points into sublists that correspond with the seperate mouse clicks.
point_7 = Point(point_6)
integer_8 = Integer(integer_7)

list_length_3 = ListLength(List=point_7)
addition = Addition(A=integer_8, B="1")
subtraction_3 = Subtraction(A=list_length_3, B="1")
merge = Merge(Data1=flatten("0"), Data2=flatten(addition), Data3=flatten(subtraction_3))
consecutive_domains = ConsecutiveDomains(Numbers=flatten(merge), Additive=False)
deconstruct_domain = DeconstructDomain(Domain=consecutive_domains)  # -> Start, End
subtraction_4 = Subtraction(A=deconstruct_domain.End, B=deconstruct_domain.Start)
partition_list = PartitionList(List=point_7, Size=subtraction_4)

point_8 = Point(partition_list)

# ---- group: Differentiate polylines from single points
# Comment: Creates two trees of points:
# Single points (created by a short click on the viewport)
# Multiple points (created by a long press on the viewport)
point_9 = Point(simplify(point_8))

list_length_4 = ListLength(List=point_9)  # -> flatten(Length)
equality_2 = Equality(FirstNumber=list_length_4, SecondNumber="1")  # -> flatten(Equality), Inequality
list_length_5 = ListLength(List=list_length_4)  # -> flatten(Length)
series_3 = Series(Start=0, Step=1, Count=list_length_5)
dispatch = Dispatch(List=series_3, DispatchPattern=equality_2.Equality)  # -> ListA, ListB
tree_branch = TreeBranch(Tree=simplify(point_9), Path=dispatch.ListA, MaintainPaths=False)
tree_branch_2 = TreeBranch(Tree=simplify(point_9), Path=dispatch.ListB, MaintainPaths=False)
clean_tree = CleanTree(RemoveNulls="true", RemoveInvalid="true", RemoveEmpty="true", Tree=tree_branch_2)  # -> simplify(Tree)

multiple_points = Point(clean_tree)
single_points = Point(tree_branch)

# ---- group: Create curve from points
point_10 = Point(multiple_points)
interpolate = Interpolate(Vertices=point_10, Degree=3, Periodic=False, KnotStyle=1)  # -> Curve, Length, Domain
curve = Curve(interpolate.Curve)

# ---- group: Output Geometry
# Description: 2019-04-20
# Lets the user draw with their mouse in the Rhino viewport and converts the mouse movement into lines and points.
# 
# This definition uses the following plugins:
# interactool
# https://www.food4rhino.com/app/interactool
# Metahopper (optional)
# https://www.food4rhino.com/app/metahopper
# 
# and the following scripts:
# 
# rec reset
# Written by Marios Tsiliakos
# 
# O_GetUsedComponents2 (optional)
# Written by Chris Hanley
interpolated_curves = Curve(curve)
multiple_points_2 = Point(multiple_points)
single_points_2 = Point(single_points)

# ---- group: Create preview sketch on GH-canvas
# Comment: Creates a sketch on the Grasshopper canvas which displays the curves.
# Usefurl when using multiple monitors.
# Uses the plugin Metahopper.
curve_2 = Curve(curve)

get_groups = GetGroups()  # -> Groups, GroupStyles, Nickname, Color
member_index = MemberIndex(Set=get_groups.Nickname, Member="sketch")  # -> Index, Count
list_item = ListItem(List=get_groups.Groups, Index=member_index.Index, Wrap=True)
obj_in_group = GetObjectsInGroup(Group=list_item)
set_sketch = SetSketch(Sketch=obj_in_group, SketchShapes=flatten(curve_2))

# ---- group: Inferior method of creating curves from points
point_11 = Point(multiple_points)

polyline = PolyLine(Vertices=point_11, Closed=False)
reduce = Reduce(Polyline=polyline, Tolerance=Slider(1.1, range=0..10))  # -> Polyline, Reduction
control_points = ControlPoints(Curve=reduce.Polyline)  # -> Points, Weights, Knots
interpolate_2 = Interpolate(Vertices=control_points.Points, Degree=Slider(3, range=0..5), Periodic=False, KnotStyle=1)  # -> Curve, Length, Domain

curve_3 = Curve(interpolate_2.Curve)
